# Grasshopper definition CBDM_ALHABIB_S1_HOPS.gh (Grasshopper 1.0.7)
# plug-ins: Pufferfish, Kangaroo2 Components

length = GetInteger(
    Slider(5, range=5..8),
    AtLeast=1,
    AtMost=1,
    Maximum=2147483647,
    Minimum=-2147483648,
    Prompt="Enter Value : 5 To 8",
    TreeAccess=False)
center_radius = GetNumber(
    Slider(2, range=2..4),
    AtLeast=1,
    AtMost=1,
    Maximum=1.797693135e+308,
    Minimum=-1.797693135e+308,
    Prompt="Enter Value : 2 To 4",
    TreeAccess=False)
sides_radius = GetNumber(
    Slider(5, range=3..5),
    AtLeast=1,
    AtMost=1,
    Maximum=1.797693135e+308,
    Minimum=-1.797693135e+308,
    Prompt="Enter Value : 3 To 5",
    TreeAccess=False)
twisting_angle = GetInteger(
    Slider(-5, range=-90..90),
    AtLeast=1,
    AtMost=1,
    Maximum=2147483647,
    Minimum=-2147483648,
    Prompt="Enter Value : -90 To 90",
    TreeAccess=False)
negative = Negative(Value=length)
construct_point = ConstructPoint(XCoordinate=length, YCoordinate=0, ZCoordinate=0)
construct_point_2 = ConstructPoint(XCoordinate=negative, YCoordinate=0, ZCoordinate=0)
line = Line(StartPoint=construct_point, EndPoint=construct_point_2)
panel = Panel(sides_radius)
panel_2 = Panel([sides_radius, center_radius, panel])
perp_frames = PerpFrames(Curve=line, Count=Slider(2, range=0..10), Align=True)  # -> Frames, Parameters
circle = Circle(Plane=perp_frames.Frames, Radius=panel_2)
panel_3 = Panel(twisting_angle)
negative_2 = Negative(Value=panel_3)
panel_4 = Panel([panel_3, "0", negative_2])
rotate = Rotate(Geometry=circle, Angle=degrees(panel_4), Plane=perp_frames.Frames)  # -> Geometry, Transform
loft = Loft(Curves=rotate.Geometry, Options={Adjust=False, Closed=False, LoftEnds=0, LoftSimp=0, LoftType=0, Rebuild=10, Refit=0.01})
mesh_surface = MeshSurface(Surface=loft, UCount=Slider(7, range=0..10), VCount=Slider(15, range=0..100), Overhang=True, Equalize=False)
offset_mesh = OffsetMesh(Mesh=mesh_surface, Distance=Slider(0.4, range=0..1), BothSides=0, CreateSolid=False)
face_boundaries = FaceBoundaries(Mesh=offset_mesh)  # -> flatten(Boundaries)
face_boundaries_2 = FaceBoundaries(Mesh=mesh_surface)  # -> flatten(Boundaries)
explode = Explode(Curve=face_boundaries, Recursive=True)  # -> Segments, Vertices
explode_2 = Explode(Curve=face_boundaries_2, Recursive=True)  # -> Segments, Vertices
curve_middle = CurveMiddle(Curve=explode.Segments)
curve_middle_2 = CurveMiddle(Curve=explode_2.Segments)
list_item = ListItem(List=curve_middle, Index=0, Wrap=True)  # -> Item, Item1, Item2, Item3
list_item_2 = ListItem(List=curve_middle_2, Index=0, Wrap=True)  # -> Item, Item1, Item2, Item3
point = Point(list_item_2.Item3)
point_2 = Point(list_item_2.Item2)
point_3 = Point(list_item.Item1)
point_4 = Point(list_item.Item2)
point_5 = Point(list_item_2.Item)
point_6 = Point(list_item_2.Item1)
point_7 = Point(list_item.Item3)
point_8 = Point(list_item.Item)
point_9 = Point(point_3)
point_10 = Point(point_7)
point_11 = Point(point_5)
point_12 = Point(point_2)
merge = Merge(Data1=point_9, Data2=point_11, Data3=point_10)
merge_2 = Merge(Data1=point_9, Data2=point_12, Data3=point_10)
polyline = PolyLine(Vertices=merge, Closed=False)
polyline_2 = PolyLine(Vertices=merge_2, Closed=False)
number_slider = Slider(0.05, range=0.03..0.06)
multipipe = MultiPipe(Curves=polyline_2, NodeSize=number_slider, EndOffset=1, StrutSize=1, Segment=0, KinkAngle=0.6, CubeFit=0, Caps=0)
multipipe_2 = MultiPipe(Curves=polyline, NodeSize=number_slider, EndOffset=1, StrutSize=1, Segment=0, KinkAngle=0.6, CubeFit=0, Caps=0)
geometry = Geometry(simplify([multipipe, multipipe_2]))
context_bake = ContextBake(Geometry=geometry)
